# Dynamo graph DynamoMaster.dyn (Dynamo 2.16.2.5624)

file_path = Filename("..\02_WIP\MyfirsWindows.py")
file_from_path = FileObject(path=file_path)
readText = FileSystem.ReadText(file=file_from_path)
categories = Categories("OST_Rooms")
all_elements_of_category = ElementsOfCategory(Category=categories)
code_block = CodeBlock()
# ---------- code_block.designscript (8 lines) ----------
[
"Nivel",
"Comentarios",
"Acabado de la base",
"Acabado del techo",
"Acabado de muro",
"Acabado del suelo"
];
# ----------------------------------------
nombre_de_la_vista_3d = StringInput("Mi_vista3D")
python_script_from_string = PythonStringNode(script=readText, IN[0]=all_elements_of_category, IN[1]=code_block, IN[2]=nombre_de_la_vista_3d)  # CPython3
