# Dynamo graph DynamoMaster.dyn (Dynamo 2.16.2.5624)

file_path = Filename("C:\Users\APF5230\Documents\Dev_ActivoDigital\03_Published\ReloadAllLinks")
file_from_path = FileObject(path=file_path)
readText = FileSystem.ReadText(file=file_from_path)
boolean = BoolSelector(true)
python_script_from_string = PythonStringNode(script=readText, IN[0]=boolean)  # CPython3
